# Dynamo graph YASER-ELIMINAR_PARAMETROS.dyn (Dynamo 2.12.1.8246)
# packages: Clockwork for Dynamo 2.x 2.6.0, Data-Shapes 2024.2.114, Orchid 2.12.5.6175

boolean = BoolSelector(true)
projectParameters = Custom[Document.ProjectParameters](toggle=boolean)  # package Clockwork for Dynamo 2.x; Retrieves all project parameters and the categories they have been assigned to
watch = Watch(projectParameters.paramName)
listview_data = Custom[Listview Data](Keys=watch, Values=watch)  # package Data-Shapes; Create data for ListView input in UI.MultiInputForm ++ . Check out www.data-shapes.net for more infos.
boolean_2 = BoolSelector(true)
multipleinputform = Custom[MultipleInputForm ++](Inputs=listview_data, Toggle=boolean_2)  # package Data-Shapes; Create a form with multiple inputs. see www.data-shapes.net for tutorials and infos!
o_projectparameter_delete = Orchid.RevitProject.Parameters.ProjectParameter.Delete(parameterName=multipleinputform.User_Inputs)
